# Grasshopper definition master_file.gh (Grasshopper 1.0.7)

expression = Expression(Expression="π")

# ----
# IMPORT_OBJ
# Rotate if necesary
rotate_bool = BooleanToggle(False)
# Right_click / select existing file
file_path = FilePath("C:\Users\JesusBarney\Desktop\ETH\THESIS\08_Github\eggShell2.0\06_Prints\20190906_casting03\20190910_final_v14.obj")
# Scale factor
scale_factor_mesh = Slider(1, range=0..15)
python_script = PythonScript(path=file_path, rotate_bool=rotate_bool, rotate_angle=expression, scale_factor=scale_factor_mesh)  # -> out, mesh, z_values, face_centers; inputs rotate_bool: Boolean
# ---------- python_script: Python ----------
import importObj
reload(importObj)

from importObj import ImportObj
import Rhino.Geometry as rg

imported_mesh = ImportObj(path, rotate_bool, scale_factor)

imported_mesh.import_obj()

if rotate_bool:
    
    imported_mesh.rotate_mesh(rotate_angle)

if scale_factor != 1:
    
    imported_mesh.scale_mesh()

imported_mesh.get_bounding_box()

imported_mesh.move_mesh()

imported_mesh.calc_normals()

z_values = imported_mesh.z_values
face_centers = imported_mesh.face_centers
mesh = imported_mesh.mesh
# ---------- end python_script ----------
# SLICER
mesh = Mesh(python_script.mesh)

geo = Geometry(<curve referenced from the Rhino model>)
geo_2 = Geometry(<curve referenced from the Rhino model>)
python = GhPythonScript()  # -> out, a
# ---------- python: Python ----------
__author__ = "JesusBarney"
__version__ = "2019.08.27"

import rhinoscriptsyntax as rs

class Employee(object):

    def __init__(self, first, last):
        self.first = first
        self.last = last

    @property
    def email(self):
        return '{}.{}@email.com'.format(self.first, self.last)

    @property
    def fullname(self):
        return '{} {}'.format(self.first, self.last)
    
    @fullname.setter
    def fullname(self, name):
        first, last = name.split(' ')
        self.first = first
        self.last = last
    
    @fullname.deleter
    def fullname(self):
        print('Delete Name!')
        self.first = None
        self.last = None


emp_1 = Employee('John', 'Smith')
emp_1.fullname = "Corey Schafer"

print(emp_1.first)
print(emp_1.email)
print(emp_1.fullname)

del emp_1.fullname
# ---------- end python ----------

# ---- group: check correct printing part, then SEND
data_dam = DataDam(DataDataA=mesh, BufferDelay=10000000, BufferMode=0)

# ----
python_2 = GhPythonScript(curve01=geo, curve02=geo_2)  # -> out, a; inputs curve01: Curve, curve02: Curve
# ---------- python_2: Python ----------
__author__ = "JesusBarney"
__version__ = "2019.08.28"

import rhinoscriptsyntax as rs
import Rhino.Geometry as rg

class SliceCurve(object):

    def __init__(self, curve):
        self.curve = curve
        self.seam = curve.PointAtStart
        divisions = curve.DivideByCount(10, True)
        self.points = [curve.PointAt(d) for d in divisions]
    
    @property
    def SCurve(self):
        return self.curve
    
    @SCurve.setter
    def SCurve(self, curve):
        self.seam = curve.PointAtStart
        divisions = curve.DivideByCount(10, True)
        self.points = [curve.PointAt(d) for d in divisions]
    
    @SCurve.deleter
    def SCurve(self):
        self.seam = None

slice_curve = SliceCurve(curve01)
print slice_curve.points
print slice_curve.seam
slice_curve.SCurve = curve02
print slice_curve.SCurve
print slice_curve.seam
print slice_curve.points

del slice_curve.SCurve

print slice_curve.seam
# ---------- end python_2 ----------
write_file = Button()
mesh_2 = Mesh(data_dam)
directory_path = FilePath("C:\Users\JesusBarney\Desktop\ETH\THESIS\08_Github\eggShell2.0\04_Code\02_Slicer\data\tests\")
geo_3 = Geometry(<point referenced from the Rhino model>)

# ----
# SLOPE_VISUALIZATION
toggle = BooleanToggle(False)
cull = CullPattern(List=python_script.z_values, CullPattern=toggle)
gradient = Gradient(
    LowerLimit=0,
    UpperLimit=1,
    Parameter=expr("(1-abs(x))", cull),
    stops=[0: RGB(255, 0, 0), 0.114: RGB(253, 54, 40), 0.473: RGB(255, 255, 0), 0.895: RGB(0, 128, 0)])
preview = CustomPreview(Geometry=python_script.face_centers, Shader=gradient)

# ----
# SLICER
python_3 = GhPythonScript(mesh=mesh_2, write_file=write_file, dir_path=directory_path, attractor_points=geo_3)  # -> out, slice, spirals, contour_curves, all_points, seams, layer_height, frame_list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; inputs mesh: Mesh, write_file: Boolean, attractor_points: list of Point3d
# ---------- python_3: Python ----------
import Rhino.Geometry as rg

"""import Slice
"""
import slice
reload(slice)
from slice import Slice

import parameters.slice_args
reload(parameters.slice_args)
from parameters.slice_args import sliceargs


"""import generateWCS
"""
import generateWCS
reload(generateWCS)
from generateWCS import GenerateWCS

import parameters.wcs_args
reload(parameters.wcs_args)
from parameters.wcs_args import wcsargs

"""import writeTxt
"""
import writeTxt
reload(writeTxt)
from writeTxt import WriteTxt

"""slice
"""
sliceargs['line_definition']    = wcsargs['line_definition']
slice = Slice(**sliceargs)
slice_curves,branch_points, branch_curves = slice.contour_mesh(mesh)
#slice_curves = slice.contour_mesh(mesh)

contour_curves = [s.curve for s in slice_curves]
seams = [s.seam for s in slice_curves]
#spirals = [s.spiral for s in slice_curves]


"""generate WCS frames
"""
wcsargs['layer_height']  = slice.layer_height
generateWCS = GenerateWCS(**wcsargs)
WCS_list, all_points = generateWCS.generate_WCS_frames(slice_curves)

v_points = []

#for WCS in WCS_list:
#    print WCS[-3]
#    if WCS[-3]>47:
#        point = rg.Point3d(WCS[0],WCS[1],WCS[2])
#        v_points.append(point)


"""writetxt
"""
if write_file:
    writetxtargs = {}
    writetxtargs['data']      = WCS_list
    writetxtargs['dir_path']  = dir_path
    writetxtargs['file_name']  = 'print.txt'
    
    write_txt = WriteTxt(**writetxtargs)
    write_txt.write_txt_file()
# ---------- end python_3 ----------

geo_4 = Geometry(python_3.v_points)
geo_5 = Geometry(python_3.branch_curves)

# ---- group: contour_curves
geo_6 = Geometry(python_3.contour_curves)

# ---- group: all_points
geo_7 = Geometry(python_3.all_points)

# ---- group: seams
geo_8 = Geometry(python_3.seams)

# ----
geo_9 = Geometry(python_3.frame_list)
geo_10 = Geometry(python_3.branch_points)
geo_11 = Geometry(python_3.spirals)
cls = Closed(Curve=geo_6)  # -> Closed, Periodic
lng = ListLength(List=geo_7)
split = SplitList(List=geo_7, Index=Slider(58101, range=0..80000))  # -> ListA, ListB
panel = Panel(cls.Closed)
panel_2 = Panel(lng)
pline = PolyLine(Vertices=geo_7, Closed=False)
item = ListItem(List=geo_6, Index=Slider(0, range=0..100), Wrap=True)
pline_2 = PolyLine(Vertices=split.ListA, Closed=False)
len = Length(Curve=pline_2)
division = Division(A=len, B=40)
division_2 = Division(A=division, B=60)
division_3 = Division()
division_4 = Division(A=division_2, B=60)
panel_3 = Panel(division_4)
